# Grasshopper definition sdk-scripts-compiling.gh (Grasshopper 1.0.7)
# plug-ins: jSwan, Populate - Lattice (Uniform), Mesh - Meshing, Logging - System Info, Primitive - Prepare (Origin), Segment Lattice, DendroGH

# ----
# Run?
boolean_toggle = BooleanToggle(True)

center_box = CenterBox(Base=PlaneXY(0, 0, 0), X=1, Y=1, Z=1)
number_slider = Slider(4, range=0..10)
sphere = Sphere(Base=PlaneXY(0, 0, 0), Radius=number_slider)
merge = Merge(Data1=sphere, Data2=number_slider)
primitive_prepare_origin = GhPythonScript(primitive=sphere)  # -> primitive, cut_surfaces, symmetry_surfaces, octant; inputs primitive: GeometryBase
# ---------- primitive_prepare_origin: Python ----------
"""Converts an input primitive to a mesh for lattice generation and provides tools for trimming the lattice with planes.
    Inputs:
        primitive: Base shape to populate with lattice geometry
    Output:
        primitive: The primitive as a closed mesh
        cut_surfaces: Top and bottom surfaces, oriented for trimming the lattice
        symmetry_surfaces: Surfaces for octant-based symmetry
        octant: Primitive mesh octant (-1, -1, -1)"""

__author__ = "irw"
__version__ = "20220124"

from ghpythonlib.componentbase import executingcomponent as component
import Grasshopper, GhPython
import System
import Rhino
import rhinoscriptsyntax as rs

def clean_primitive(primitive):
    if (primitive.ObjectType == Rhino.DocObjects.ObjectType.Brep):
        meshed_brep = Rhino.Geometry.Mesh.CreateFromBrep(primitive, Rhino.Geometry.MeshingParameters(1))
        meshed_primitive = Rhino.Geometry.Mesh()
        for mesh in meshed_brep:
            meshed_primitive.Append(mesh)

        meshed_primitive.HealNakedEdges(0.01)
    else:
        meshed_primitive = primitive

    meshed_primitive.UnifyNormals()
    meshed_primitive.Weld(3.1415)
    if(meshed_primitive.Volume() < 0):
        meshed_primitive.Flip(True, True, True)

    return meshed_primitive

def get_cut_planes(primitive):
    primitive = rs.coercegeometry(primitive)
    bbox = primitive.GetBoundingBox(True)
    scaled_bbox = bbox
    center = bbox.Center
    center_plane = Rhino.Geometry.Plane(center, Rhino.Geometry.Vector3d(0,0,1))
    scaled_bbox.Transform(Rhino.Geometry.Transform.Scale(center_plane, 1.2, 1.2, 1))

    x_length = scaled_bbox.Max[0] - scaled_bbox.Min[0]
    x_interval = Rhino.Geometry.Interval(-x_length/2, x_length/2)

    y_length = scaled_bbox.Max[1] - scaled_bbox.Min[1]
    y_interval = Rhino.Geometry.Interval(-y_length/2, y_length/2)

    z_vector = Rhino.Geometry.Vector3d(0,0,1)

    top_point = Rhino.Geometry.Point3d(center[0],center[1],bbox.Max[2])
    top_plane = Rhino.Geometry.Plane(top_point, -z_vector)
    top_surface = Rhino.Geometry.PlaneSurface(top_plane, x_interval, y_interval)

    bottom_point = Rhino.Geometry.Point3d(center[0],center[1],bbox.Min[2])
    bottom_plane = Rhino.Geometry.Plane(bottom_point, z_vector)
    bottom_surface = Rhino.Geometry.PlaneSurface(bottom_plane, x_interval, y_interval)

    return top_surface, bottom_surface

def get_symmetry_planes(primitive):
    bbox = primitive.GetBoundingBox(True)

    min_coord_x = bbox.Min[0]*1.2
    max_coord_x = bbox.Max[0]*1.2
    x_interval = Rhino.Geometry.Interval(min_coord_x, max_coord_x)
    
    min_coord_y = bbox.Min[1]*1.2
    max_coord_y = bbox.Max[1]*1.2
    y_interval = Rhino.Geometry.Interval(min_coord_y, max_coord_y)
    
    min_coord_z = bbox.Min[2]*1.2
    max_coord_z = bbox.Max[2]*1.2
    z_interval = Rhino.Geometry.Interval(min_coord_z, max_coord_z)

    zx_x_interval = Rhino.Geometry.Interval(bbox.Min[0]*1.2, bbox.Max[0]*1.2)
    zx_z_interval = Rhino.Geometry.Interval((bbox.Min[2]-bbox.Center[2])*1.2, (bbox.Max[2]-bbox.Center[2])*1.2)
    yz_y_interval = Rhino.Geometry.Interval(bbox.Min[1]*1.2, bbox.Max[1]*1.2)
    yz_z_interval = Rhino.Geometry.Interval((bbox.Min[2]-bbox.Center[2])*1.2, (bbox.Max[2]-bbox.Center[2])*1.2)

    plane_point = bbox.Center

    XY_cut = Rhino.Geometry.PlaneSurface(Rhino.Geometry.Plane(plane_point, Rhino.Geometry.Vector3d(0,0,-1)), x_interval, y_interval)
    YZ_cut = Rhino.Geometry.PlaneSurface(Rhino.Geometry.Plane(plane_point, Rhino.Geometry.Vector3d(-1,0,0)), yz_y_interval, yz_z_interval)
    ZX_cut = Rhino.Geometry.PlaneSurface(Rhino.Geometry.Plane(plane_point, Rhino.Geometry.Vector3d(0,-1,0)), zx_z_interval, zx_x_interval)

    return XY_cut, YZ_cut, ZX_cut

def split_mesh(primitive, surfaces):
    planes = set()
    for surface in surfaces:
        planes.add(Rhino.Geometry.Mesh.CreateFromSurface(surface, Rhino.Geometry.MeshingParameters(1)))
    octant = Rhino.Geometry.Mesh.CreateBooleanDifference({primitive}, planes)

    return octant

class Primitive(component):
    def RunScript(self, primitive):
        primitive = clean_primitive(primitive)
        cut_surfaces = get_cut_planes(primitive)
        symmetry_surfaces = get_symmetry_planes(primitive)
        octant = split_mesh(primitive, symmetry_surfaces)
        
        return primitive, cut_surfaces, symmetry_surfaces, octant
# ---------- end primitive_prepare_origin ----------
number = Number("5")
brep_wireframe = BrepWireframe(Brep=center_box, Density=-1)
mesh = Mesh(center_box)
geometry = Geometry(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)
length = Length(Curve=geometry)

# ----
# Write
boolean_toggle_2 = BooleanToggle(False)

control_points = ControlPoints(Curve=geometry)  # -> Points, Weights, Knots
end_points = EndPoints(Curve=geometry)  # -> Start, End
box_array = BoxArray(Geometry=center_box, Cell=center_box, XCount=10, YCount=10, ZCount=10)  # -> Geometry, Transform
interpolate = Interpolate(Vertices=control_points.Points, Degree=3, Periodic=False, KnotStyle=1)  # -> Curve, Length, Domain
polyline = PolyLine(Vertices=control_points.Points, Closed=False)
line = Line(StartPoint=end_points.Start, EndPoint=end_points.End)
original_curve = Geometry(geometry)
bounding_box = BoundingBox(Content=box_array.Geometry, Plane=PlaneXY(0, 0, 0), UnionBox=True)  # -> Box, Box_2
geometry_2 = Geometry(original_curve)
number_slider_2 = Slider(0.1, range=0..0.1)
box_properties = BoxProperties(Box=bounding_box.Box)  # -> Center, Diagonal, Area, Volume, Degeneracy
explode = Explode(Curve=geometry_2, Recursive=True)  # -> Segments, Vertices
create_settings = CreateSettings(VoxelSize=0.05, Bandwidth=1, Isovalue=0, Adaptivity=0.9)
group = Group(Objects=explode.Segments)
move = Move(Geometry=box_array.Geometry, Motion=expr("x*-1", box_properties.Center))  # -> Geometry, Transform
populate_lattice_uniform = GhPythonScript(boundary_voxels=move.Geometry, unit_cell=brep_wireframe, connectivity=mesh, primitive=primitive_prepare_origin.primitive)  # -> lattice_core, lattice_boundary, lattice_trimmed, lattice_boundary_connect, lattice_skin; inputs core_voxels: list, boundary_voxels: list, unit_cell: list of Curve
# ---------- populate_lattice_uniform: Python ----------
"""Population for a uniform strut lattice
    Inputs:
        core_voxels: Voxels to populate with unit cell only
        boundary_voxels: Voxels to populate with unit cell and get connectivity
        unit_cell: Lines and curves making up the repeat unit
        connectivity: Unit cell connectivity
        primitive: Trimming boundary
    Output:
        lattice_core: Core voxels populated with unit cells
        lattice_boundary: Boundary voxels populated with unit cells
        lattice_trimmed: Trimmed lattice within primitive
        lattice_boundary_connect: Boundary voxels populated with connectivity
        lattice_skin: Net skin of the lattice"""

__author__ = "irw"
__version__ = "2022.01.31"

from ghpythonlib.componentbase import executingcomponent as component
import Grasshopper, GhPython
import System
import Rhino
import rhinoscriptsyntax as rs
import ghpythonlib.components as ghcomp
import ghpythonlib.parallel
import ghpythonlib.treehelpers as th

def get_bounding_box(unit_cell):
        precise_box = False
        unit_cell_bounds = unit_cell[0].GetBoundingBox(precise_box)
        for line in unit_cell:
            box = line.GetBoundingBox(precise_box)
            unit_cell_bounds = Rhino.Geometry.BoundingBox.Union(unit_cell_bounds, box)
        return unit_cell_bounds

def check_inclusion(lattice_curve, mesh):
    lattice_curve.Domain = Rhino.Geometry.Interval(0,1)
    midpoint = lattice_curve.PointAt(0.5)
    keep = mesh.IsPointInside(midpoint, 0.001, True)
    return keep

def check_curve_parallel(curve):
    curve = Rhino.Geometry.Curve.TryGetPolyline(curve)[1]
    curve = Rhino.Geometry.PolylineCurve(curve)
    intersection_points = Rhino.Geometry.Intersect.Intersection.MeshPolyline(primitive_global, curve)[0]
    if intersection_points:
        curve_params = []
        for point in intersection_points:
            curve_params.append(curve.ClosestPoint(point)[1])
        split_curve = curve.Split(curve_params)
        for section in split_curve:
            if (check_inclusion(section, primitive_global)):
                lattice_trimmed.append(section)
    else:
        if (check_inclusion(curve, primitive_global)):
            lattice_trimmed.append(curve)

def populate_lattice_parallel(voxels):
    lattice_structure = []
    for curve in unit_cell_global:
        mapped = ghcomp.BoxMapping(curve, unit_cell_bounds, voxels)[0]
        lattice_structure.append(mapped)
    return lattice_structure

def populate_connectivity_parallel(voxels):
    connect = ghcomp.BoxMapping(connectivity_global, unit_cell_bounds, voxels)[0]
    return connect

def populate_skin_parallel(voxels):
    connect = ghcomp.BoxMapping(connectivity_global, unit_cell_bounds, voxels)[0]
    # curves = Rhino.Geometry.Intersect.Intersection.MeshMeshAccurate(connect, primitive,  Rhino.RhinoMath.SqrtEpsilon*10)
    curves = ghcomp.MeshXMesh(primitive_global, connect)
    return curves


class UniformLattice(component):
    def RunScript(self, core_voxels, boundary_voxels, unit_cell, connectivity, primitive):
        global unit_cell_bounds
        global unit_cell_global
        global connectivity_global
        global primitive_global
        global lattice_trimmed

        unit_cell_global = unit_cell
        connectivity_global = connectivity
        primitive_global = primitive
        unit_cell_bounds = get_bounding_box(unit_cell)
        unit_cell = Rhino.Geometry.Curve.JoinCurves(unit_cell)
        if core_voxels:
            lattice_core = ghpythonlib.parallel.run(populate_lattice_parallel, core_voxels, True)
        else:
            lattice_core = []
        if boundary_voxels:
            lattice_boundary = ghpythonlib.parallel.run(populate_lattice_parallel, boundary_voxels, True)
            lattice_boundary_connect = ghpythonlib.parallel.run(populate_connectivity_parallel, boundary_voxels, True)
            lattice_skin = ghpythonlib.parallel.run(populate_skin_parallel, boundary_voxels, True)
        else:
            lattice_boundary = []
            lattice_boundary_connect = []
            lattice_skin = []

        lattice_trimmed = []
        lattice_combined = list(lattice_core) + list(lattice_boundary)
        valid_curves = list(filter(None, lattice_combined))
        ghpythonlib.parallel.run(check_curve_parallel, valid_curves, False)

        return lattice_core, lattice_boundary, lattice_trimmed, lattice_boundary_connect, lattice_skin
# ---------- end populate_lattice_uniform ----------
geometry_3 = Geometry([populate_lattice_uniform.lattice_trimmed, populate_lattice_uniform.lattice_skin])
logging_system_info = GhPythonScript(refresh=geometry_3, project_dir="dev-lattice-generation", id_properties=merge)  # -> part_id, date_utc, mesh_path, log_path, gh_file, base_unit, device, rhino_build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; inputs refresh: list, id_properties: list
# ---------- logging_system_info: Python ----------
"""Provides a scripting component.
    Inputs:
        refresh: Recalculate the component
        project_dir: The project's main directory
        save_directory: Folder to save the STL and log output
        id_properties: Key features of the part. Takes single value or list of properties
    Output:
        part_id: A unique ID for the generated part. Takes the format (date)-(properties fragment)-(instance fragment)
        date_utc: The UTC date and time at which computation was performed
        mesh_path: Full path for the STL output
        log_path: Full path for the log output
        gh_file: Path and name of the Grasshopper definition
        base_unit: Base unit of the Rhino and Grasshopper file (e.g. millimeter)
        device: Device used for computation
        rhino_build: Rhino software version
        rhino_date: Rhino software version release date
        gh_build: Grasshopper software version
        gh_date: Grasshopper software version release date
        core_dependencies: Default libraries used in this definition
        addon_dependencies: Installed libraries used in this definition"""

__author__ = "irw"
# Includes script components from Giulio Piacentino, source: https://www.grasshopper3d.com/forum/topics/gh-filename-is-python
__version__ = "20220124"

from ghpythonlib.componentbase import executingcomponent as component
import Grasshopper, GhPython
import System
import Rhino
import rhinoscriptsyntax as rs
import scriptcontext
import os
import hashlib
from datetime import datetime

def make_id(properties):
    properties_string = ','.join(map(str, properties))
    properties_fragment = (hashlib.md5(properties_string.encode("UTF-8")).hexdigest())[:3]

    date_info = datetime.now().strftime("%y%m%d")
    date_utc = datetime.utcnow().strftime("%Y-%m-%dT%H:%M:%S")
    instance_fragment = (hashlib.sha256(date_utc.encode("UTF-8")).hexdigest())[:2]

    unique_id = '-'.join([date_info, properties_fragment, instance_fragment])
    
    return unique_id, date_utc

def get_libraries(self):
    core_libraries = {}
    addon_libraries = {}
    objids = {}
    
    server = Grasshopper.Instances.ComponentServer
    for obj in self.OnPingDocument().Objects:
        if obj == self: continue #Ignore this component.
        
        objId = obj.ComponentGuid
        if objids.has_key(objId): continue
        objids[objId] = ""
        
        lib = server.FindAssemblyByObject(obj)
        if lib == None: continue
        if core_libraries.has_key(lib.Id) or addon_libraries.has_key(lib.Id): continue
        
        if lib.IsCoreLibrary:
            core_libraries[lib.Id] = lib
        else:
            addon_libraries[lib.Id] = lib
    
    return core_libraries, addon_libraries

def get_units(ghdoc):
    scriptcontext.doc = Rhino.RhinoDoc.ActiveDoc
    base_units = rs.UnitSystemName()
    scriptcontext.doc = ghdoc
    
    return base_units

def get_device():
    device = Rhino.Runtime.HostUtils.DeviceId.ToString()

    return device

def get_software_build():
    rhino_build = str(Rhino.RhinoApp.Version)
    rhino_date = Rhino.RhinoApp.BuildDate
    gh_build = str(Grasshopper.Versioning.Version)
    gh_date = Grasshopper.Versioning.BuildDate

    return rhino_build, rhino_date, gh_build, gh_date

class SystemInfo(component):
    def RunScript(self, refresh, project_dir, save_directory, id_properties):
        ghdoc = scriptcontext.doc
        part_id = None
        date_utc = None
        gh_file = None
        base_unit = None
        device = None
        rhino_build = None
        rhino_date = None
        gh_build = None
        gh_date = None
        core_dependencies = None
        addon_dependencies = None


        part_id, date_utc = make_id(id_properties)
        gh_path = os.path.realpath(ghdoc.Path)

        if not save_directory:
            save_directory = os.path.dirname(ghdoc.Path)

        file_name_base = "\\".join([save_directory, part_id])
        mesh_path = "\"{}.stl\"".format(file_name_base)
        log_path = "{}.txt".format(file_name_base)

        if project_dir:
            gh_file = gh_path.split(project_dir)[1]
        else:
            gh_file = gh_path

        base_unit = get_units(ghdoc)
        device = get_device()
        rhino_build, rhino_date, gh_build, gh_date = get_software_build()


        core_libraries, addon_libraries = get_libraries(self)

        core_dependencies = []
        for id, lib in core_libraries.iteritems():
            core_dependencies.append("{0} {1}".format(lib.Name, lib.Version))

        addon_dependencies = []
        for id, lib in addon_libraries.iteritems():
            addon_dependencies.append("{0} {1}".format(lib.Name, lib.Version))
        
        return part_id, date_utc, mesh_path, log_path, gh_file, base_unit, device, rhino_build, rhino_date, gh_build, gh_date, core_dependencies, addon_dependencies
# ---------- end logging_system_info ----------
serialize_json = SerializeJson(
    Gh_file=logging_system_info.gh_file,
    Base_unit=logging_system_info.base_unit,
    Device=logging_system_info.device,
    Rhino_build=logging_system_info.rhino_build,
    Rhino_date=logging_system_info.rhino_date,
    Gh_build=logging_system_info.gh_build,
    Gh_date=logging_system_info.gh_date,
    Core_dependencies=logging_system_info.core_dependencies,
    Addon_dependencies=logging_system_info.addon_dependencies,
    IncludeNullAndEmptyProperties=False)
serialize_json_2 = SerializeJson(Part_id=logging_system_info.part_id, Date_utc=logging_system_info.date_utc, IncludeNullAndEmptyProperties=False)
serialize_json_3 = SerializeJson(Computation=serialize_json, IncludeNullAndEmptyProperties=False)
mesh_meshing = GhPythonScript(
    run=boolean_toggle,
    curves=geometry_3,
    radius=number_slider_2,
    dendroSettings=create_settings,
    surfaces=primitive_prepare_origin.symmetry_surfaces,
    save=boolean_toggle_2,
    file_name=logging_system_info.mesh_path)  # -> out_mesh, original_report, mod_report, cut_report, volume, area; inputs run: Boolean, curves: list of Curve, radius: list, surfaces: list of Surface, bake: Boolean, save: Boolean, delete: Boolean
# ---------- mesh_meshing: Python ----------
"""Convert a lattice frame to a printable mesh. Includes options to save with modifications for 3D printing.
    Inputs:
        run: Run the script?
        curves: The lattice curves for meshing
        radius: Radius of the lattice curves
        dendroSettings: Settings provided by the Dendro component
        cut_surfaces: Cutting surfaces for trimming the lattice
        bake: Bake the part into Rhino?
        save: Save the part?
        file_name: Where to save the part
        delete: Delete the part after saving?
    Output:
        out_mesh: Dendro-generated mesh of lattice
        original_report: Mesh report for original lattice
        mod_report: Mesh report for modified lattice, with minimal alterations
        cut_report: Mesh report for trimmed lattice
        volume: Volume of the final lattice in document units
        area: Surface area of the final lattice in document units"""

__author__ = "irw"
__version__ = "20220124"

from ghpythonlib.componentbase import executingcomponent as component
import Grasshopper, GhPython
import System
import Rhino
import rhinoscriptsyntax as rs
import ghpythonlib.components as ghcomp

out_mesh = None

def to_json(key, value):
    return '"{}" : "{}"'.format(key, value)

def to_json_value_object_pair(key, value):
    return '"{}" : {{{}}}'.format(key, value)

def get_mesh_report(report_instance, additional_params = None):
    naked_count = 0
    naked_edges = out_mesh.GetNakedEdges()
    if naked_edges is not None:
        naked_count = len(naked_edges)
        
    properties = []
    report = to_json("report_version", report_instance)
    valid = to_json("valid_mesh", out_mesh.IsValid)
    naked = to_json("naked_edges", naked_count)
    closed = to_json("closed_mesh", out_mesh.IsClosed)
    manifold = to_json("manifold_mesh", out_mesh.IsManifold(True))
    disjoint = to_json("disjoint_count", out_mesh.DisjointMeshCount)
    vertices = to_json("vertex_count", out_mesh.Vertices.Count)
    memory = to_json("memory_estimate_mb", out_mesh.MemoryEstimate()*1e-6)
    log = to_json("log_invalid", out_mesh.IsValidWithLog()[1])
    
    properties.extend([report, valid, naked, closed, manifold, disjoint, vertices, memory, log])
    if additional_params:
        properties.extend(additional_params)

    properties_json = '{{{}}}'.format(to_json_value_object_pair(report_instance, ','.join(properties)))

    return properties_json

def get_cut_planes(surfaces, translation_factor = 0):
    planes = set()
    for surface in surfaces:
        normal_vector = surface.NormalAt(u = 0, v = 0)
        surface.Translate(translation_factor*normal_vector)
        planes.add(Rhino.Geometry.Mesh.CreateFromSurface(surface, Rhino.Geometry.MeshingParameters(1)))

    return planes

class MeshLattice(component):
    def RunScript(self, run, curves, radius, dendroSettings, cut_surfaces, bake, save, file_name, delete):
        global out_mesh
        original_report = None
        cut_report = None
        volume = None
        area = None
        
        if run:
            #   Generate lattice volume and mesh
            out_mesh = ghcomp.DendroGH.CurveToVolume(curves = curves, curve_radius = radius, settings = dendroSettings)
            out_mesh = ghcomp.DendroGH.VolumetoMesh(volume = out_mesh, volume_settings = dendroSettings)

            original_bounds = out_mesh.GetBoundingBox(True)
            original_report = get_mesh_report(report_instance = "original_report")

            #   Make checks and first repairs
            degenerate_faces = to_json("degenerate_faces", out_mesh.Faces.RemoveZeroAreaFaces(0))
            quads_to_tris = to_json("quads_to_tris", out_mesh.Faces.ConvertQuadsToTriangles())
            out_mesh.UnifyNormals()
            mesh_flipped = False
            if(out_mesh.Volume() < 0):
                out_mesh.Flip(True, True, True)
                mesh_flipped = True
            mesh_flipped = to_json("mesh_flipped", mesh_flipped)
            mod_report = get_mesh_report(report_instance = "modified_report", additional_params=[degenerate_faces, quads_to_tris, mesh_flipped])

            #    Split mesh
            if cut_surfaces:
                revised_cut = False
                planes = get_cut_planes(cut_surfaces)
                cut_mesh = Rhino.Geometry.Mesh.CreateBooleanDifference({out_mesh}, planes)[0]
                cut_bounds = cut_mesh.GetBoundingBox(True)

                if (cut_bounds.Volume/original_bounds.Volume < 0.01):
                    revised_cut = True
                    planes = get_cut_planes(cut_surfaces, translation_factor = 0.01)
                    out_mesh = Rhino.Geometry.Mesh.CreateBooleanDifference({out_mesh}, planes)[0]
                else:
                    out_mesh = cut_mesh

                # out_mesh.Weld(3.1415)
                revised_cut = to_json("revised_cut", revised_cut)
                face_count_cut = to_json("face_count_cut", out_mesh.Faces.Count)
                fill_success = to_json("fill_success", out_mesh.FillHoles())
                face_count_filled = to_json("face_count_filled", out_mesh.Faces.Count)
                cut_report = get_mesh_report(report_instance = "cut_report", additional_params=[revised_cut, face_count_cut, fill_success, face_count_filled])

            #   Keep until main script is validated
            #    if (a.GetNakedEdges()):
            #        print a.GetNakedEdges()
            #        print a.Vertices.Align(distance = 1e-1, whichVertices = a.GetNakedEdgePointStatus())
            #        a.ExtractNonManifoldEdges(False)
            #        a.Faces.ExtractDuplicateFaces()
            #        print a.Vertices.Align(distance = 1e-1, whichVertices = a.GetNakedEdgePointStatus()) 

            #   Calculate mesh properties
            volume = out_mesh.Volume()
            areaMassProperties = Rhino.Geometry.AreaMassProperties.Compute(out_mesh)
            area = areaMassProperties.Area

            #   Export
            if bake or save:
                id = Rhino.RhinoDoc.ActiveDoc.Objects.Add(out_mesh)
                id = str(id)

                if save:
                    rs.Command("SelID " + id)
                    rs.Command("-Export " + file_name + " Enter")
                
                    if delete:
                        rs.Command("SelID " + id)
                        rs.Command("Delete")
                
            rs.Command("ClearUndo")
            return out_mesh, original_report, mod_report, cut_report, volume, area
# ---------- end mesh_meshing ----------
serialize_json_4 = SerializeJson(
    Input_shape="Sphere",
    Dimension_1=number_slider,
    Lattice_volume=mesh_meshing.volume,
    Lattice_area=mesh_meshing.area,
    IncludeNullAndEmptyProperties=False)
merge_2 = Merge(
    Data1=serialize_json_2,
    Data2=serialize_json_4,
    Data3=serialize_json_3,
    Data4=mesh_meshing.original_report,
    Data5=mesh_meshing.mod_report,
    Data6=mesh_meshing.cut_report)  # -> flatten(Result)
logging_combine_json = GhPythonScript(input_json=merge_2)  # -> combined_json; inputs input_json: list
# ---------- logging_combine_json: Python ----------
"""Combines a list of JSON inputs into a single JSON object for output.
    Inputs:
        input_json: JSON objects to combine
    Output:
       combined_json: Combined inputs"""

__author__ = "irw"
__version__ = "20220126"

from ghpythonlib.componentbase import executingcomponent as component
import Grasshopper, GhPython
import System
import Rhino
import json
from collections import OrderedDict

def combine_inputs(input_json):
    m = OrderedDict()
    for item in input_json:
        if item:
            m.update(json.loads(str(item), object_pairs_hook=OrderedDict))
    return m

class CombineJson(component):
    def RunScript(self, input_json):
        merged = combine_inputs(input_json)
        combined_json = json.dumps(merged, sort_keys=False, indent=4, separators=(',', ': '))

        return combined_json
# ---------- end logging_combine_json ----------
repeat_data = RepeatData(Data=group, Length="1000")
ungroup = Ungroup(Group=repeat_data)  # -> flatten(Objects)
repeat_data_2 = RepeatData(Data=geometry_2, Length="1000")
segment_lattice = GhPythonScript(curves=geometry_2, radius="5")  # -> points; inputs curves: list of Curve
# ---------- segment_lattice: Python ----------
"""Convert lattice to points for meshing
    Inputs:
        curves: Curves that make up the lattice
        radius: Minimum radius value for generating mesh
    Output:
        points: Points to input to lattice meshing component"""

__author__ = "irw"
__version__ = "2022.03.23"

from ghpythonlib.componentbase import executingcomponent as component
import Grasshopper, GhPython
import System
import Rhino
import rhinoscriptsyntax as rs
import ghpythonlib.components as ghcomp
import ghpythonlib.parallel
import ghpythonlib.treehelpers as th

def segment_curves_parallel(curve):
    params = curve.DivideByLength(segment_length, False)
    points = []
    points.append(curve.PointAtStart)
    for t in params:
        points.append(curve.PointAt(t))
    points.append(curve.PointAtEnd)
    return points

class SegmentLattice(component):
    def RunScript(self, curves, radius):
        global segment_length 
        segment_length = float(radius)/5
        
        if curves:
            points = ghpythonlib.parallel.run(segment_curves_parallel, curves, True)

        return points
# ---------- end segment_lattice ----------
segment_lattice_2 = SegmentLattice(Curves=geometry_2, Radius=number)
ghpython_script = GhPythonScript(curves=ungroup, radius="5")  # -> curve_points; inputs curves: list of Curve
# ---------- ghpython_script: Python ----------
"""Convert lattice to points for meshing
    Inputs:
        curves: Curves that make up the lattice
        radius: Minimum radius value for generating mesh
    Output:
        curve_points: Points to input to lattice meshing component"""

__author__ = "irw"
__version__ = "2022.03.23"

from ghpythonlib.componentbase import executingcomponent as component
import Grasshopper, GhPython
import System
import Rhino
import rhinoscriptsyntax as rs
import ghpythonlib.components as ghcomp
import ghpythonlib.parallel
import ghpythonlib.treehelpers as th

def segment_curves_parallel(curve):
    params = curve.DivideByLength(segment_length, False)
    points = []
    points.append(curve.PointAtStart)
    for t in params:
        points.append(curve.PointAt(t))
    points.append(curve.PointAtEnd)
    return points

class SegmentLattice(component):
    def RunScript(self, curves, radius):
        global segment_length 
        segment_length = float(radius)/5
        
        if curves:
            curve_points = ghpythonlib.parallel.run(segment_curves_parallel, curves, True)

        return curve_points
# ---------- end ghpython_script ----------
ghpython_script_2 = GhPythonScript(curves=repeat_data_2, radius="5")  # -> curve_points; inputs curves: list of Curve; same code as ghpython_script
panel = Panel(logging_combine_json)
geometry_4 = Geometry(geometry_3)
divide_length = DivideLength(Curve=flatten(geometry_4), Length=expr("x/4", number_slider_2))  # -> Points, Tangents, Parameters
end_points_2 = EndPoints(Curve=geometry_4)  # -> Start, End
merge_3 = Merge(Data1=divide_length.Points, Data2=end_points_2.End)  # -> flatten(Result)
logging_logger = GhPythonScript(file_path=logging_system_info.log_path, content=panel, write_file=boolean_toggle_2)  # inputs content: list, write_file: Boolean
# ---------- logging_logger: Python ----------
"""Writes text input to a file.
    Inputs:
        file_path: Path to the file to write
        content: Content to write to the file
        write_file: Write the file?"""

__author__ = "ianrw"
__version__ = "20220124"

from ghpythonlib.componentbase import executingcomponent as component
import Grasshopper, GhPython
import System
import Rhino
import rhinoscriptsyntax as rs
import scriptcontext
import os

def write_lines(file, content):
    for line in content:
        file.write(line)
    file.close()

class Logger(component):
    def RunScript(self, file_path, content, write_file):
        ghdoc = scriptcontext.doc

        if write_file and file_path:
            # working_dir = os.path.dirname(os.path.realpath(ghdoc.Path))
            # file_path = os.path.join(working_dir, file_path)

            if (os.path.exists(file_path)):
                file = open(file_path, "a")
                if (os.stat(file_path).st_size != 0):
                    file.write("," + "\n")           
                write_lines(file, content)

            else:
                file = open(file_path, "w")
                write_lines(file, content)
# ---------- end logging_logger ----------
mesh_meshing_2 = GhPythonScript(
    run=boolean_toggle,
    points=flatten(merge_3),
    radius=number_slider_2,
    dendroSettings=create_settings,
    surfaces=primitive_prepare_origin.symmetry_surfaces,
    save=boolean_toggle_2,
    file_name=logging_system_info.mesh_path)  # -> out_mesh, original_report, mod_report, cut_report, volume, area; inputs run: Boolean, points: list of Point3d, radius: list, surfaces: list of Surface, bake: Boolean, save: Boolean, delete: Boolean
# ---------- mesh_meshing_2: Python ----------
"""Convert lattice points to a printable mesh. Includes options to save with modifications for 3D printing.
    Inputs:
        run: Run the script?
        points: The lattice points for meshing
        radius: Radius of the lattice curves
        dendroSettings: Settings provided by the Dendro component
        cut_surfaces: Cutting surfaces for trimming the lattice
        bake: Bake the part into Rhino?
        save: Save the part?
        file_name: Where to save the part
        delete: Delete the part after saving?
    Output:
        out_mesh: Dendro-generated mesh of lattice
        original_report: Mesh report for original lattice
        mod_report: Mesh report for modified lattice, with minimal alterations
        cut_report: Mesh report for trimmed lattice
        volume: Volume of the final lattice in document units
        area: Surface area of the final lattice in document units"""

__author__ = "irw"
__version__ = "20220306"

from ghpythonlib.componentbase import executingcomponent as component
import Grasshopper, GhPython
import System
import Rhino
import rhinoscriptsyntax as rs
import ghpythonlib.components as ghcomp

out_mesh = None

def to_json(key, value):
    return '"{}" : "{}"'.format(key, value)

def to_json_value_object_pair(key, value):
    return '"{}" : {{{}}}'.format(key, value)

def get_mesh_report(report_instance, additional_params = None):
    naked_count = 0
    naked_edges = out_mesh.GetNakedEdges()
    if naked_edges is not None:
        naked_count = len(naked_edges)
        
    properties = []
    report = to_json("report_version", report_instance)
    valid = to_json("valid_mesh", out_mesh.IsValid)
    naked = to_json("naked_edges", naked_count)
    closed = to_json("closed_mesh", out_mesh.IsClosed)
    manifold = to_json("manifold_mesh", out_mesh.IsManifold(True))
    disjoint = to_json("disjoint_count", out_mesh.DisjointMeshCount)
    vertices = to_json("vertex_count", out_mesh.Vertices.Count)
    memory = to_json("memory_estimate_mb", out_mesh.MemoryEstimate()*1e-6)
    log = to_json("log_invalid", out_mesh.IsValidWithLog()[1])
    
    properties.extend([report, valid, naked, closed, manifold, disjoint, vertices, memory, log])
    if additional_params:
        properties.extend(additional_params)

    properties_json = '{{{}}}'.format(to_json_value_object_pair(report_instance, ','.join(properties)))

    return properties_json

def get_cut_planes(surfaces, translation_factor = 0):
    planes = set()
    for surface in surfaces:
        normal_vector = surface.NormalAt(u = 0, v = 0)
        surface.Translate(translation_factor*normal_vector)
        planes.add(Rhino.Geometry.Mesh.CreateFromSurface(surface, Rhino.Geometry.MeshingParameters(1)))

    return planes

class MeshLattice(component):
    def RunScript(self, run, points, radius, dendroSettings, cut_surfaces, bake, save, file_name, delete):
        global out_mesh
        original_report = None
        cut_report = None
        volume = None
        area = None
        
        if run:
            #   Generate lattice volume and mesh
            out_mesh = ghcomp.DendroGH.PointsToVolume(points = points, point_radius = radius, settings = dendroSettings)
            out_mesh = ghcomp.DendroGH.VolumetoMesh(volume = out_mesh, volume_settings = dendroSettings)

            original_bounds = out_mesh.GetBoundingBox(True)
            original_report = get_mesh_report(report_instance = "original_report")

            #   Make checks and first repairs
            degenerate_faces = to_json("degenerate_faces", out_mesh.Faces.RemoveZeroAreaFaces(0))
            quads_to_tris = to_json("quads_to_tris", out_mesh.Faces.ConvertQuadsToTriangles())
            out_mesh.UnifyNormals()
            mesh_flipped = False
            if(out_mesh.Volume() < 0):
                out_mesh.Flip(True, True, True)
                mesh_flipped = True
            mesh_flipped = to_json("mesh_flipped", mesh_flipped)
            mod_report = get_mesh_report(report_instance = "modified_report", additional_params=[degenerate_faces, quads_to_tris, mesh_flipped])

            #    Split mesh
            if cut_surfaces:
                revised_cut = False
                planes = get_cut_planes(cut_surfaces)
                cut_mesh = Rhino.Geometry.Mesh.CreateBooleanDifference({out_mesh}, planes)[0]
                cut_bounds = cut_mesh.GetBoundingBox(True)

                if (cut_bounds.Volume/original_bounds.Volume < 0.01):
                    revised_cut = True
                    planes = get_cut_planes(cut_surfaces, translation_factor = 0.01)
                    out_mesh = Rhino.Geometry.Mesh.CreateBooleanDifference({out_mesh}, planes)[0]
                else:
                    out_mesh = cut_mesh

                # out_mesh.Weld(3.1415)
                revised_cut = to_json("revised_cut", revised_cut)
                face_count_cut = to_json("face_count_cut", out_mesh.Faces.Count)
                fill_success = to_json("fill_success", out_mesh.FillHoles())
                face_count_filled = to_json("face_count_filled", out_mesh.Faces.Count)
                cut_report = get_mesh_report(report_instance = "cut_report", additional_params=[revised_cut, face_count_cut, fill_success, face_count_filled])

            #   Keep until main script is validated
            #    if (a.GetNakedEdges()):
            #        print a.GetNakedEdges()
            #        print a.Vertices.Align(distance = 1e-1, whichVertices = a.GetNakedEdgePointStatus())
            #        a.ExtractNonManifoldEdges(False)
            #        a.Faces.ExtractDuplicateFaces()
            #        print a.Vertices.Align(distance = 1e-1, whichVertices = a.GetNakedEdgePointStatus()) 

            #   Calculate mesh properties
            volume = out_mesh.Volume()
            areaMassProperties = Rhino.Geometry.AreaMassProperties.Compute(out_mesh)
            area = areaMassProperties.Area

            #   Export
            if bake or save:
                id = Rhino.RhinoDoc.ActiveDoc.Objects.Add(out_mesh)
                id = str(id)

                if save:
                    rs.Command("SelID " + id)
                    rs.Command("-Export " + file_name + " Enter")
                
                    if delete:
                        rs.Command("SelID " + id)
                        rs.Command("Delete")
                
            rs.Command("ClearUndo")
            return out_mesh, original_report, mod_report, cut_report, volume, area
# ---------- end mesh_meshing_2 ----------
# Compiled versions
primitive_prepare_origin_2 = PrimitivePrepareOrigin(Primitive=sphere)  # -> Primitive, Cut_surfaces, Symmetry_surfaces, Octant
# Solution: return meshes from primitive component
mesh_2 = Mesh(primitive_prepare_origin_2.Cut_surfaces)
ghpython_script_3 = GhPythonScript(surfaces=primitive_prepare_origin_2.Cut_surfaces)  # -> a; inputs surfaces: list of Mesh
# ---------- ghpython_script_3: Python ----------
from ghpythonlib.componentbase import executingcomponent as component
import Grasshopper, GhPython
import System
import Rhino
import rhinoscriptsyntax as rs

class MyComponent(component):
    
    def RunScript(self, surfaces):
        """Provides a scripting component.
            Inputs:
                x: The x script variable
                y: The y script variable
            Output:
                a: The a output variable"""
                
        __author__ = "ianrw"
        __version__ = "2022.03.23"
                
        import rhinoscriptsyntax as rs
        import Rhino
                
        def get_cut_planes(surfaces, translation_factor = 0):
            planes = set()
            for surface in surfaces:
                print(type(surface))
                planes.add('{}{}'.format(surfaces.index(surface), type(surface)))
                reference_point = surface.GetBoundingBox(False).Center

                normal_vector = surface.NormalAt(surface.ClosestMeshPoint(reference_point, 0.0))
#                normal_vector = surface.NormalAt(u = 0, v = 0)
                surface.Translate(translation_factor*normal_vector)
                planes.add(surface)
#                planes.add(Rhino.Geometry.Mesh.CreateFromSurface(surface, Rhino.Geometry.MeshingParameters(1)))
                        
            return planes
                
        a = get_cut_planes(surfaces)
                
        
        # return outputs if you have them; here I try it for you:
        return a
# ---------- end ghpython_script_3 ----------
populate_lattice_uniform_2 = PopulateLatticeUniform(
    Boundary_voxels=move.Geometry,
    Unit_cell=brep_wireframe,
    Connectivity=mesh,
    Primitive=primitive_prepare_origin_2.Primitive)  # -> Lattice_core, Lattice_boundary, Lattice_trimmed, Lattice_boundary_connect, Lattice_skin
# Script
primitive_prepare_origin_3 = GhPythonScript(primitive=sphere)  # -> primitive, cut_surfaces, symmetry_surfaces, octant; inputs primitive: GeometryBase
# ---------- primitive_prepare_origin_3: Python ----------
"""Converts an input primitive to a mesh for lattice generation and provides tools for trimming the lattice with planes.
    Inputs:
        primitive: Base shape to populate with lattice geometry
    Output:
        primitive: The primitive as a closed mesh
        cut_surfaces: Top and bottom surfaces, oriented for trimming the lattice
        symmetry_surfaces: Surfaces for octant-based symmetry
        octant: Primitive mesh octant (-1, -1, -1)"""

__author__ = "irw"
__version__ = "20220124"

from ghpythonlib.componentbase import executingcomponent as component
import Grasshopper, GhPython
import System
import Rhino
import rhinoscriptsyntax as rs

def clean_primitive(primitive):
    if (primitive.ObjectType == Rhino.DocObjects.ObjectType.Brep):
        meshed_brep = Rhino.Geometry.Mesh.CreateFromBrep(primitive, Rhino.Geometry.MeshingParameters(1))
        meshed_primitive = Rhino.Geometry.Mesh()
        for mesh in meshed_brep:
            meshed_primitive.Append(mesh)

        meshed_primitive.HealNakedEdges(0.01)
    else:
        meshed_primitive = primitive

    meshed_primitive.UnifyNormals()
    meshed_primitive.Weld(3.1415)
    if(meshed_primitive.Volume() < 0):
        meshed_primitive.Flip(True, True, True)

    return meshed_primitive

def get_cut_planes(primitive):
    primitive = rs.coercegeometry(primitive)
    bbox = primitive.GetBoundingBox(True)
    scaled_bbox = bbox
    center = bbox.Center
    center_plane = Rhino.Geometry.Plane(center, Rhino.Geometry.Vector3d(0,0,1))
    scaled_bbox.Transform(Rhino.Geometry.Transform.Scale(center_plane, 1.2, 1.2, 1))

    x_length = scaled_bbox.Max[0] - scaled_bbox.Min[0]
    x_interval = Rhino.Geometry.Interval(-x_length/2, x_length/2)

    y_length = scaled_bbox.Max[1] - scaled_bbox.Min[1]
    y_interval = Rhino.Geometry.Interval(-y_length/2, y_length/2)

    z_vector = Rhino.Geometry.Vector3d(0,0,1)

    top_point = Rhino.Geometry.Point3d(center[0],center[1],bbox.Max[2])
    top_plane = Rhino.Geometry.Plane(top_point, -z_vector)
    top_surface = Rhino.Geometry.PlaneSurface(top_plane, x_interval, y_interval)

    bottom_point = Rhino.Geometry.Point3d(center[0],center[1],bbox.Min[2])
    bottom_plane = Rhino.Geometry.Plane(bottom_point, z_vector)
    bottom_surface = Rhino.Geometry.PlaneSurface(bottom_plane, x_interval, y_interval)

    return [Rhino.Geometry.Mesh.CreateFromSurface(surface, Rhino.Geometry.MeshingParameters(1)) for surface in [top_surface, bottom_surface]]

def get_symmetry_planes(primitive):
    bbox = primitive.GetBoundingBox(True)

    min_coord_x = bbox.Min[0]*1.2
    max_coord_x = bbox.Max[0]*1.2
    x_interval = Rhino.Geometry.Interval(min_coord_x, max_coord_x)
    
    min_coord_y = bbox.Min[1]*1.2
    max_coord_y = bbox.Max[1]*1.2
    y_interval = Rhino.Geometry.Interval(min_coord_y, max_coord_y)
    
    min_coord_z = bbox.Min[2]*1.2
    max_coord_z = bbox.Max[2]*1.2
    z_interval = Rhino.Geometry.Interval(min_coord_z, max_coord_z)

    zx_x_interval = Rhino.Geometry.Interval(bbox.Min[0]*1.2, bbox.Max[0]*1.2)
    zx_z_interval = Rhino.Geometry.Interval((bbox.Min[2]-bbox.Center[2])*1.2, (bbox.Max[2]-bbox.Center[2])*1.2)
    yz_y_interval = Rhino.Geometry.Interval(bbox.Min[1]*1.2, bbox.Max[1]*1.2)
    yz_z_interval = Rhino.Geometry.Interval((bbox.Min[2]-bbox.Center[2])*1.2, (bbox.Max[2]-bbox.Center[2])*1.2)

    plane_point = bbox.Center

    XY_cut = Rhino.Geometry.PlaneSurface(Rhino.Geometry.Plane(plane_point, Rhino.Geometry.Vector3d(0,0,-1)), x_interval, y_interval)
    YZ_cut = Rhino.Geometry.PlaneSurface(Rhino.Geometry.Plane(plane_point, Rhino.Geometry.Vector3d(-1,0,0)), yz_y_interval, yz_z_interval)
    ZX_cut = Rhino.Geometry.PlaneSurface(Rhino.Geometry.Plane(plane_point, Rhino.Geometry.Vector3d(0,-1,0)), zx_z_interval, zx_x_interval)

    return [Rhino.Geometry.Mesh.CreateFromSurface(surface, Rhino.Geometry.MeshingParameters(1)) for surface in [XY_cut, YZ_cut, ZX_cut]]

class Primitive(component):
    def RunScript(self, primitive):
        primitive = clean_primitive(primitive)
        cut_surfaces = get_cut_planes(primitive)
        symmetry_surfaces = get_symmetry_planes(primitive)
        octant = Rhino.Geometry.Mesh.CreateBooleanDifference({primitive}, symmetry_surfaces)
        
        return primitive, cut_surfaces, symmetry_surfaces, octant
# ---------- end primitive_prepare_origin_3 ----------
# Compiled
primitive_prepare_origin_20220323 = PrimitivePrepareOrigin20220323(Primitive=sphere)  # -> Primitive, Cut_surfaces, Symmetry_surfaces, Octant
# Error: 1. Solution exception:'Brep' object has no attribute 'NormalAt'
mesh_meshing_3 = MeshMeshing(
    Run=boolean_toggle,
    Curves=[populate_lattice_uniform_2.Lattice_trimmed, populate_lattice_uniform_2.Lattice_skin],
    Radius=number_slider_2,
    DendroSettings=create_settings,
    Surfaces=primitive_prepare_origin_2.Cut_surfaces,
    Save=boolean_toggle_2,
    File_name=logging_system_info.mesh_path)  # -> Out_mesh, Original_report, Mod_report, Cut_report, Volume, Area
# Script
mesh_meshing_4 = GhPythonScript()  # -> out_mesh, original_report, mod_report, cut_report, volume, area; inputs run: Boolean, points: list of Point3d, radius: list, surfaces: list of Mesh, bake: Boolean, save: Boolean, delete: Boolean
# ---------- mesh_meshing_4: Python ----------
"""Convert lattice points to a printable mesh. Includes options to save with modifications for 3D printing.
    Inputs:
        run: Run the script?
        points: The lattice points for meshing
        radius: Radius of the lattice curves
        dendroSettings: Settings provided by the Dendro component
        cut_surfaces: Cutting meshes for trimming the lattice
        bake: Bake the part into Rhino?
        save: Save the part?
        file_name: Where to save the part
        delete: Delete the part after saving?
    Output:
        out_mesh: Dendro-generated mesh of lattice
        original_report: Mesh report for original lattice
        mod_report: Mesh report for modified lattice, with minimal alterations
        cut_report: Mesh report for trimmed lattice
        volume: Volume of the final lattice in document units
        area: Surface area of the final lattice in document units"""

__author__ = "irw"
__version__ = "20220306"

from ghpythonlib.componentbase import executingcomponent as component
import Grasshopper, GhPython
import System
import Rhino
import rhinoscriptsyntax as rs
import ghpythonlib.components as ghcomp

out_mesh = None

def to_json(key, value):
    return '"{}" : "{}"'.format(key, value)

def to_json_value_object_pair(key, value):
    return '"{}" : {{{}}}'.format(key, value)

def get_mesh_report(report_instance, additional_params = None):
    naked_count = 0
    naked_edges = out_mesh.GetNakedEdges()
    if naked_edges is not None:
        naked_count = len(naked_edges)
        
    properties = []
    report = to_json("report_version", report_instance)
    valid = to_json("valid_mesh", out_mesh.IsValid)
    naked = to_json("naked_edges", naked_count)
    closed = to_json("closed_mesh", out_mesh.IsClosed)
    manifold = to_json("manifold_mesh", out_mesh.IsManifold(True))
    disjoint = to_json("disjoint_count", out_mesh.DisjointMeshCount)
    vertices = to_json("vertex_count", out_mesh.Vertices.Count)
    memory = to_json("memory_estimate_mb", out_mesh.MemoryEstimate()*1e-6)
    log = to_json("log_invalid", out_mesh.IsValidWithLog()[1])
    
    properties.extend([report, valid, naked, closed, manifold, disjoint, vertices, memory, log])
    if additional_params:
        properties.extend(additional_params)

    properties_json = '{{{}}}'.format(to_json_value_object_pair(report_instance, ','.join(properties)))

    return properties_json

def get_cut_planes(surfaces, translation_factor = 0):
        planes = set()
        for surface in surfaces:
            print(type(surface))
            reference_point = surface.GetBoundingBox(False).Center
            normal_vector = surface.NormalAt(surface.ClosestMeshPoint(reference_point, 0.0))
            surface.Translate(translation_factor*normal_vector)
            planes.add(surface)
                    
        return planes

class MeshLattice(component):
    def RunScript(self, run, points, radius, dendroSettings, cut_surfaces, bake, save, file_name, delete):
        global out_mesh
        original_report = None
        cut_report = None
        volume = None
        area = None
        
        if run:
            #   Generate lattice volume and mesh
            out_mesh = ghcomp.DendroGH.PointsToVolume(points = points, point_radius = radius, settings = dendroSettings)
            out_mesh = ghcomp.DendroGH.VolumetoMesh(volume = out_mesh, volume_settings = dendroSettings)

            original_bounds = out_mesh.GetBoundingBox(True)
            original_report = get_mesh_report(report_instance = "original_report")

            #   Make checks and first repairs
            degenerate_faces = to_json("degenerate_faces", out_mesh.Faces.RemoveZeroAreaFaces(0))
            quads_to_tris = to_json("quads_to_tris", out_mesh.Faces.ConvertQuadsToTriangles())
            out_mesh.UnifyNormals()
            mesh_flipped = False
            if(out_mesh.Volume() < 0):
                out_mesh.Flip(True, True, True)
                mesh_flipped = True
            mesh_flipped = to_json("mesh_flipped", mesh_flipped)
            mod_report = get_mesh_report(report_instance = "modified_report", additional_params=[degenerate_faces, quads_to_tris, mesh_flipped])

            #    Split mesh
            if cut_surfaces:
                revised_cut = False
                planes = get_cut_planes(cut_surfaces)
                cut_mesh = Rhino.Geometry.Mesh.CreateBooleanDifference({out_mesh}, planes)[0]
                cut_bounds = cut_mesh.GetBoundingBox(True)

                if (cut_bounds.Volume/original_bounds.Volume < 0.01):
                    revised_cut = True
                    planes = get_cut_planes(cut_surfaces, translation_factor = 0.01)
                    out_mesh = Rhino.Geometry.Mesh.CreateBooleanDifference({out_mesh}, planes)[0]
                else:
                    out_mesh = cut_mesh

                # out_mesh.Weld(3.1415)
                revised_cut = to_json("revised_cut", revised_cut)
                face_count_cut = to_json("face_count_cut", out_mesh.Faces.Count)
                fill_success = to_json("fill_success", out_mesh.FillHoles())
                face_count_filled = to_json("face_count_filled", out_mesh.Faces.Count)
                cut_report = get_mesh_report(report_instance = "cut_report", additional_params=[revised_cut, face_count_cut, fill_success, face_count_filled])

            #   Keep until main script is validated
            #    if (a.GetNakedEdges()):
            #        print a.GetNakedEdges()
            #        print a.Vertices.Align(distance = 1e-1, whichVertices = a.GetNakedEdgePointStatus())
            #        a.ExtractNonManifoldEdges(False)
            #        a.Faces.ExtractDuplicateFaces()
            #        print a.Vertices.Align(distance = 1e-1, whichVertices = a.GetNakedEdgePointStatus()) 

            #   Calculate mesh properties
            volume = out_mesh.Volume()
            areaMassProperties = Rhino.Geometry.AreaMassProperties.Compute(out_mesh)
            area = areaMassProperties.Area

            #   Export
            if bake or save:
                id = Rhino.RhinoDoc.ActiveDoc.Objects.Add(out_mesh)
                id = str(id)

                if save:
                    rs.Command("SelID " + id)
                    rs.Command("-Export " + file_name + " Enter")
                
                    if delete:
                        rs.Command("SelID " + id)
                        rs.Command("Delete")
                
            rs.Command("ClearUndo")
            return out_mesh, original_report, mod_report, cut_report, volume, area
# ---------- end mesh_meshing_4 ----------
# Compiled
mesh_meshing_points_20220323 = MeshMeshingPoints20220323(
    Run=boolean_toggle,
    Points=merge_3,
    Radius=number_slider_2,
    DendroSettings=create_settings,
    Surfaces=primitive_prepare_origin_20220323.Symmetry_surfaces,
    Save=boolean_toggle_2,
    File_name=logging_system_info.mesh_path)  # -> Out_mesh, Original_report, Mod_report, Cut_report, Volume, Area
mesh_to_volume = MeshToVolume(Mesh=mesh_meshing_points_20220323.Out_mesh, Settings=create_settings)
scale = Scale(Geometry=mesh_to_volume, Center=Point(-0.1, -0.1, -0.1), Factor=1.1)  # -> Geometry, Transform
mesh_meshing_volume_20220323 = MeshMeshingVolume20220323(
    Run=Toggle(True),
    DendroVolume=scale.Geometry,
    DendroSettings=create_settings,
    Surfaces=primitive_prepare_origin_20220323.Symmetry_surfaces,
    Bake=Toggle(True),
    Save=Toggle(True),
    File_name=logging_system_info.mesh_path,
    Delete=Toggle(True))  # -> Out_mesh, Original_report, Mod_report, Cut_report, Volume, Area
mesh_meshing_5 = GhPythonScript(
    run=Toggle(True),
    dendroVolume=scale.Geometry,
    dendroSettings=create_settings,
    surfaces=primitive_prepare_origin_20220323.Symmetry_surfaces)  # -> out_mesh, original_report, mod_report, cut_report, volume, area; inputs run: Boolean, radius: list, surfaces: list of Mesh, bake: Boolean, save: Boolean, delete: Boolean
# ---------- mesh_meshing_5: Python ----------
"""Dendro Volume To Mesh with repairs and reports
    Inputs:
        run: Run the script?
        volume: The volume for meshing
        radius: Radius of the lattice curves
        dendroSettings: Settings provided by the Dendro component
        cut_surfaces: Cutting meshes for trimming the lattice
        bake: Bake the part into Rhino?
        save: Save the part?
        file_name: Where to save the part
        delete: Delete the part after saving?
    Output:
        out_mesh: Dendro-generated mesh of lattice
        original_report: Mesh report for original lattice
        mod_report: Mesh report for modified lattice, with minimal alterations
        cut_report: Mesh report for trimmed lattice
        volume: Volume of the final lattice in document units
        area: Surface area of the final lattice in document units"""

__author__ = "irw"
__version__ = "20220323"

from ghpythonlib.componentbase import executingcomponent as component
import Grasshopper, GhPython
import System
import Rhino
import rhinoscriptsyntax as rs
import ghpythonlib.components as ghcomp

out_mesh = None

def to_json(key, value):
    return '"{}" : "{}"'.format(key, value)

def to_json_value_object_pair(key, value):
    return '"{}" : {{{}}}'.format(key, value)

def get_mesh_report(report_instance, additional_params = None):
    naked_count = 0
    naked_edges = out_mesh.GetNakedEdges()
    if naked_edges is not None:
        naked_count = len(naked_edges)
        
    properties = []
    report = to_json("report_version", report_instance)
    valid = to_json("valid_mesh", out_mesh.IsValid)
    naked = to_json("naked_edges", naked_count)
    closed = to_json("closed_mesh", out_mesh.IsClosed)
    manifold = to_json("manifold_mesh", out_mesh.IsManifold(True))
    disjoint = to_json("disjoint_count", out_mesh.DisjointMeshCount)
    vertices = to_json("vertex_count", out_mesh.Vertices.Count)
    memory = to_json("memory_estimate_mb", out_mesh.MemoryEstimate()*1e-6)
    log = to_json("log_invalid", out_mesh.IsValidWithLog()[1])
    
    properties.extend([report, valid, naked, closed, manifold, disjoint, vertices, memory, log])
    if additional_params:
        properties.extend(additional_params)

    properties_json = '{{{}}}'.format(to_json_value_object_pair(report_instance, ','.join(properties)))

    return properties_json

def get_cut_planes(surfaces, translation_factor = 0):
        planes = set()
        for surface in surfaces:
            print(type(surface))
            reference_point = surface.GetBoundingBox(False).Center
            normal_vector = surface.NormalAt(surface.ClosestMeshPoint(reference_point, 0.0))
            surface.Translate(translation_factor*normal_vector)
            planes.add(surface)
                    
        return planes

class MeshLattice(component):
    def RunScript(self, run, dendroVolume, radius, dendroSettings, cut_surfaces, bake, save, file_name, delete):
        global out_mesh
        original_report = None
        cut_report = None
        volume = None
        area = None
        
        print(run)
        print(dendroVolume)
        print(dendroSettings)
        
        if run:
            #   Generate lattice volume and mesh
            out_mesh = ghcomp.DendroGH.VolumetoMesh(volume = dendroVolume, volume_settings = dendroSettings)

            original_bounds = out_mesh.GetBoundingBox(True)
            original_report = get_mesh_report(report_instance = "original_report")

            #   Make checks and first repairs
            degenerate_faces = to_json("degenerate_faces", out_mesh.Faces.RemoveZeroAreaFaces(0))
            quads_to_tris = to_json("quads_to_tris", out_mesh.Faces.ConvertQuadsToTriangles())
            out_mesh.UnifyNormals()
            mesh_flipped = False
            if(out_mesh.Volume() < 0):
                out_mesh.Flip(True, True, True)
                mesh_flipped = True
            mesh_flipped = to_json("mesh_flipped", mesh_flipped)
            mod_report = get_mesh_report(report_instance = "modified_report", additional_params=[degenerate_faces, quads_to_tris, mesh_flipped])

            #    Split mesh
            if cut_surfaces:
                revised_cut = False
                planes = get_cut_planes(cut_surfaces)
                cut_mesh = Rhino.Geometry.Mesh.CreateBooleanDifference({out_mesh}, planes)[0]
                cut_bounds = cut_mesh.GetBoundingBox(True)

                if (cut_bounds.Volume/original_bounds.Volume < 0.01):
                    revised_cut = True
                    planes = get_cut_planes(cut_surfaces, translation_factor = 0.01)
                    out_mesh = Rhino.Geometry.Mesh.CreateBooleanDifference({out_mesh}, planes)[0]
                else:
                    out_mesh = cut_mesh

                # out_mesh.Weld(3.1415)
                revised_cut = to_json("revised_cut", revised_cut)
                face_count_cut = to_json("face_count_cut", out_mesh.Faces.Count)
                fill_success = to_json("fill_success", out_mesh.FillHoles())
                face_count_filled = to_json("face_count_filled", out_mesh.Faces.Count)
                cut_report = get_mesh_report(report_instance = "cut_report", additional_params=[revised_cut, face_count_cut, fill_success, face_count_filled])

            #   Keep until main script is validated
            #    if (a.GetNakedEdges()):
            #        print a.GetNakedEdges()
            #        print a.Vertices.Align(distance = 1e-1, whichVertices = a.GetNakedEdgePointStatus())
            #        a.ExtractNonManifoldEdges(False)
            #        a.Faces.ExtractDuplicateFaces()
            #        print a.Vertices.Align(distance = 1e-1, whichVertices = a.GetNakedEdgePointStatus()) 

            #   Calculate mesh properties
            volume = out_mesh.Volume()
            areaMassProperties = Rhino.Geometry.AreaMassProperties.Compute(out_mesh)
            area = areaMassProperties.Area

            #   Export
            if bake or save:
                id = Rhino.RhinoDoc.ActiveDoc.Objects.Add(out_mesh)
                id = str(id)

                if save and file_name:
                    rs.Command("SelID " + id)
                    rs.Command("-Export " + file_name + " Enter")
                
                    if delete:
                        rs.Command("SelID " + id)
                        rs.Command("Delete")
                
            rs.Command("ClearUndo")
            return out_mesh, original_report, mod_report, cut_report, volume, area
# ---------- end mesh_meshing_5 ----------
logging_system_info_2 = LoggingSystemInfo(Refresh=geometry_3, Project_dir="dev-lattice-generation", Id_properties=merge)  # -> Part_id, Date_utc, Mesh_path, Log_path, Gh_file, Base_unit, Device, Rhino_build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
